# Grasshopper definition BIMSC-S3_HW1.gh (Grasshopper 1.0.8)
# plug-ins: eleFront5

# ---- group: Roof Slab Thickness
mm = Slider(200, range=0..1000)

# ---- group: Column Radius
mm_2 = Slider(300, range=0..1000)

# ---- group: Total Height
mm_3 = Slider(4000, range=0..10000)

# ----
extrusion = Extrusion(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)
python_3_script = Python3Script(extrusion=extrusion)  # -> top_crv; inputs extrusion: Extrusion
# ---------- python_3_script: Python ----------
top_crv = extrusion.Profile3d(0,1.0)
# ---------- end python_3_script ----------
unit_z = UnitZ(Factor=mm_3)
panel = Panel(python_3_script)
curve = Curve(python_3_script)

# ----
# COLUMNS
negative = Negative(Value=mm_2)
offset_curve = OffsetCurve(Curve=curve, Distance=negative, Corners=1)
divide_curve = DivideCurve(Curve=offset_curve, Count=Slider(13, range=0..20), Kinks=False)  # -> Points, Tangents, Parameters
circle = Circle(Plane=PlaneXY(0, 0, 0), Radius=mm_2)
area = Area(Geometry=circle)  # -> Area, Centroid
subtraction = Subtraction(A=mm_3, B=mm)
orient = Orient(Geometry=circle, Source=area.Centroid, Target=divide_curve.Points)  # -> Geometry, Transform
unit_z_2 = UnitZ(Factor=subtraction)
extrude = Extrude(Base=orient.Geometry, Direction=unit_z_2)

column_height_mm = Panel(subtraction)

# ----
# TOP SLAB
negative_2 = Negative(Value=mm)
move = Move(Geometry=curve, Motion=unit_z)  # -> Geometry, Transform
unit_z_3 = UnitZ(Factor=negative_2)
boundary_surfaces = BoundarySurfaces(Edges=move.Geometry)
extrude_2 = Extrude(Base=boundary_surfaces, Direction=unit_z_3)

# ----
# FACADE
number_slider = Slider(0.71, range=0.01..0.99)
number_slider_2 = Slider(0.4, range=0..1)
cluster = Cluster(
    base_closed_curve=curve,
    vertical_offset_height=unit_z,
    tween_factor=number_slider,
    scale_factor=Slider(1.1, range=1..1.5))  # -> top_closed_curve, tween_curve_2
cluster_2 = Cluster(
    base_closed_curve=curve,
    vertical_offset_height=unit_z,
    tween_factor=number_slider_2,
    scale_factor=Slider(1.3, range=1..1.5))  # -> top_closed_curve, tween_curve_2

subtraction_2 = Subtraction(A=number_slider, B=number_slider_2)

cluster_3 = Cluster(
    base_closed_curve=curve,
    vertical_offset_height=unit_z,
    tween_factor=expr("x/2", subtraction_2),
    scale_factor=Slider(1.04, range=0.78..1.1))  # -> top_closed_curve, tween_curve_2
merge = Merge(
    Data1=curve,
    Data2=cluster.tween_curve_2,
    Data3=cluster_3.tween_curve_2,
    Data4=cluster_2.tween_curve_2,
    Data5=cluster_2.top_closed_curve)  # -> flatten(Result)
loft = Loft(Curves=merge, Options={Adjust=False, Closed=False, LoftEnds=0, LoftSimp=0, LoftType=0, Rebuild=10, Refit=0.01})

# ----
# OUT
floor_slab = EleFrontDataDescription(extrusion, ShiftDepth=0, isNameSet=True)
columns = EleFrontDataDescription(extrude, ShiftDepth=0, isNameSet=True)
facade = EleFrontDataDescription(loft, ShiftDepth=0, isNameSet=True)
top_slab = EleFrontDataDescription(extrude_2, ShiftDepth=0, isNameSet=True)

# ==== cluster Cluster

# ----
# IN
base_closed_curve = ClusterInput()
vertical_offset_height = ClusterInput()
tween_factor = ClusterInput()
scale_factor = ClusterInput()

move = Move(BaseClosedCurve=base_closed_curve, VerticalOffsetHeight=vertical_offset_height)  # -> TopClosedCurve, Transform
tween_curve = TweenCurve(TopClosedCurve=move.TopClosedCurve, BaseClosedCurve=base_closed_curve, TweenFactor=tween_factor, BlendType=0)
area = Area(Geometry=tween_curve)  # -> Area, Centroid
scale = Scale(Geometry=tween_curve, Center=area.Centroid, ScaleFactor=scale_factor)  # -> _TweenCurve, Transform

# ----
# OUT
top_closed_curve = ClusterOutput(move.TopClosedCurve)
tween_curve_2 = ClusterOutput(scale._TweenCurve)
