# Grasshopper definition add.gh (Grasshopper 1.0.8)

number_slider = Slider(0, range=0..20)
panel = Panel("""105
5
30""")
a = GetNumber(panel, AtLeast=1, AtMost=1, Maximum=1.797693135e+308, Minimum=-1.797693135e+308, TreeAccess=True)
b = GetNumber(Slider(0, range=0..20), AtLeast=1, AtMost=1, Maximum=1.797693135e+308, Minimum=-1.797693135e+308, TreeAccess=False)
ma = MassAddition(Input=a)  # -> Result, PartialResults
addition = Addition(A=ma.Result, B=b)
c_print = ContextPrint(Result=addition)
