# Grasshopper definition bamb_u.gh (Grasshopper 1.0.8)

diameter = Slider(4.5, range=3..6)
height = Slider(3.5, range=2..5)
count = Slider(3, range=2..7)
offset = Slider(0.2, range=0..0.5)
subdivision = GetInteger(
    Slider(4, range=3..5),
    AtLeast=1,
    AtMost=1,
    Maximum=2147483647,
    Minimum=-2147483648,
    Prompt="Number of vertical subdivision",
    TreeAccess=False)
diameter_2 = GetNumber(
    diameter,
    AtLeast=1,
    AtMost=1,
    Maximum=1.797693135e+308,
    Minimum=-1.797693135e+308,
    Prompt="Upper Diameter",
    TreeAccess=False)
height_2 = GetNumber(
    height,
    AtLeast=1,
    AtMost=1,
    Maximum=1.797693135e+308,
    Minimum=-1.797693135e+308,
    Prompt="Total Height",
    TreeAccess=False)
count_2 = GetInteger(count, AtLeast=1, AtMost=1, Maximum=2147483647, Minimum=-2147483648, Prompt="Total Trees Count", TreeAccess=False)
offset_2 = GetNumber(
    offset,
    AtLeast=1,
    AtMost=1,
    Maximum=1.797693135e+308,
    Minimum=-1.797693135e+308,
    Prompt="Offset between Trees",
    TreeAccess=False)
series = Series(Start=0, Step=1, Count=expr("x+1", subdivision))
division = Division(A=series, B=subdivision)
basediameter = Panel("0.8")
graph_mapper = GraphMapper(division, x0=0, x1=1, y0=0, y1=1, Cx=0.5875308514, Cy=0.1760832667, container_name="Conic")
construct_domain = ConstructDomain(DomainStart=basediameter, DomainEnd=diameter_2)
multiplication = Multiplication(A=division, B=height_2)
remap_numbers = RemapNumbers(Value=graph_mapper, Source=Domain(0, 1), Target=construct_domain)  # -> Mapped, Clipped
expression = Expression(r=diameter_2, n="6", Expression="r*tan(π/n)/sin(π/n)")
unit_z = UnitZ(Factor=multiplication)
multiplication_2 = Multiplication(A=diameter_2, B="8")
circle = Circle(Plane=PlaneXY(0, 0, 0), Radius=expr("x/2", remap_numbers.Mapped))
round = Round(Number=multiplication_2)  # -> Nearest, Floor, Ceiling
move = Move(Geometry=circle, Motion=unit_z)  # -> Geometry, Transform
polygon = Polygon(Plane=PlaneXY(0, 0, 0), Radius=expr("x/2", expression), Segments="6", FilletRadius=0)  # -> Polygon, Length
polygon_2 = Polygon(Plane=PlaneXY(0, 0, 0), Radius=expr("x/2", diameter_2), Segments="6", FilletRadius=0)  # -> Polygon, Length
list_item = ListItem(List=multiplication, Index=0, Wrap=True)  # -> Item1, Item
panel = Panel(round.Nearest)
offset_curve = OffsetCurve(Curve=polygon.Polygon, Distance=offset_2, Corners=1)
divide_curve = DivideCurve(Curve=move.Geometry, Count=round.Nearest, Kinks=False)  # -> Points, Tangents, Parameters
explode = Explode(Curve=offset_curve, Recursive=True)  # -> Segments, Vertices
explode_2 = Explode(Curve=polygon_2.Polygon, Recursive=True)  # -> Segments, Vertices
negative = Negative(Value=series)
shift_list = ShiftList(List=divide_curve.Points, Shift=graft(series), Wrap=True)
line = Line(StartPoint=explode.Vertices, EndPoint=explode_2.Vertices)
shift_list_2 = ShiftList(List=divide_curve.Points, Shift=graft(negative), Wrap=True)
end_points = EndPoints(Curve=explode.Segments)  # -> Start, End
unit_z_2 = UnitZ(Factor=1)
flip_matrix = FlipMatrix(Data=shift_list)
flip_matrix_2 = FlipMatrix(Data=shift_list_2)
unit_z_3 = UnitZ(Factor=list_item.Item1)
construct_plane = ConstructPlane(Origin=end_points.Start, XAxis=explode.Segments, YAxis=unit_z_2)
interpolate = Interpolate(Vertices=flip_matrix_2, Degree=3, Periodic=False, KnotStyle=1)  # -> Curve, Length, Domain
interpolate_2 = Interpolate(Vertices=flip_matrix, Degree=3, Periodic=False, KnotStyle=1)  # -> Curve, Length, Domain
move_2 = Move(Geometry=offset_curve, Motion=unit_z_3)  # -> Geometry, Transform
move_3 = Move(Geometry=line, Motion=unit_z_3)  # -> Geometry, Transform
merge = Merge(Data1=interpolate_2.Curve, Data2=interpolate.Curve)
merge_2 = Merge(Data1=move_2.Geometry, Data2=move_3.Geometry)
pipe = Pipe(Curve=move.Geometry, Radius=0.015, Caps=0, FitRail=False)
pipe_2 = Pipe(Curve=merge, Radius=0.015, Caps=0, FitRail=False)
pipe_3 = Pipe(Curve=merge_2, Radius=0.015, Caps=0, FitRail=False)
merge_3 = Merge(Data1=pipe_2, Data2=pipe, Data3=pipe_3)  # -> flatten(Result)
mirror = Mirror(Geometry=graft(merge_3), Plane=construct_plane)  # -> Geometry, Transform
flip_matrix_3 = FlipMatrix(Data=mirror.Geometry)  # -> simplify(Data)
series_2 = Series(Start=0, Step=1, Count=expr("x-1", count_2))
explode_tree = ExplodeTree(Data=flip_matrix_3)  # -> Branch0, Branch1, Branch2, Branch3, Branch4, Branch5
tree_branch = TreeBranch(Tree=flip_matrix_3, Path=series_2, MaintainPaths=True)
merge_4 = Merge(Data1=merge_3, Data2=tree_branch)
context_bake = ContextBake(Geometry=merge_4)
