# Grasshopper definition hops.gh (Grasshopper 1.0.8)
# plug-ins: Hops

number_slider = Slider(1, range=0..10)
panel = Panel("""15
5
10
1""")
file_path = FilePath("C:\Users\danie\Documents\Github_iaac\bimsc26-datamgmt-session01\SpikeyThing.gh")
file_path_2 = FilePath("C:\Users\danie\Documents\Github_iaac\bimsc26-datamgmt-session01\add.gh")
panel_2 = Panel(file_path)
hops = Hops(
    _Path=file_path,
    Radius=Slider(5, range=0..10),
    Count=Slider(42, range=0..100),
    Length=20,
    CacheResultsInMemory=True,
    CacheSolveResults=True,
    RemoteDefinitionLocation="C:\Users\danie\Documents\Github_iaac\bimsc26-datamgmt-session01\SpikeyThing.gh",
    RemoteSolveVersion=(0, 1, 0),
    ShowInput_Enabled=False,
    ShowInput_Path=True,
    SynchronousSolve=True)  # -> Geometry, Faces
hops_2 = Hops(
    _Path=file_path_2,
    A=panel,
    B=Slider(9, range=0..10),
    CacheResultsInMemory=True,
    CacheSolveResults=True,
    RemoteDefinitionLocation="C:\Users\danie\Documents\Github_iaac\bimsc26-datamgmt-session01\add.gh",
    RemoteSolveVersion=(0, 1, 0),
    ShowInput_Enabled=False,
    ShowInput_Path=True,
    SynchronousSolve=True)
panel_3 = Panel(hops_2)
